# Grasshopper definition rest-polling.gh (Grasshopper 1.0.6)

c_script = CSharpScript(reset=Button(), run=Toggle(True))  # -> out, A; inputs reset: Boolean, run: Boolean
# ---------- c_script: C# ----------
    if (reset)
      n = 0;
    else if(run){
      n++;
      Component.ExpireSolution(true);
    }

    A = n;
# ---------- c_script: C# additional code ----------
  int n = 0;
# ---------- end c_script ----------

python = GhPythonScript(x="http://jfh.wtf:3720/settings?id=1", y=c_script.A)  # -> out, a
# ---------- python: Python ----------
import urllib2
import scriptcontext as rs

if y % 50 == 0:
    contents = urllib2.urlopen(x).read()
    rs.sticky["apiValue"] = contents
    print contents
# ---------- end python ----------
python_2 = GhPythonScript(x=c_script.A)  # -> out, a
# ---------- python_2: Python ----------
import scriptcontext as rs
if "apiValue" in rs.sticky:
    a = rs.sticky["apiValue"]
# ---------- end python_2 ----------
panel = Panel(python_2.a)
panel_2 = Panel(python.out)
